# Grasshopper definition honeybee-ifc.gh (Grasshopper 1.0.7)
# plug-ins: Human

panel = Panel("C:\Users\devan\simulation\FamilyHouse_AC13.hbjson")
panel_2 = Panel("C:\Users\devan\simulation\BEM_Example_ArchiCAD.hbjson")
loadobjects = HBLoadObjects(hb_file="C:\Users\devan\simulation\SmallOffice_d_IFC2x3.hbjson", load=Toggle(True))  # -> report, hb_objs; plug-in component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
vizbytype = HBVisualizeByType(hb_objs=loadobjects.hb_objs)  # -> walls, interior_walls, roofs, ceilings, exterior_floors, interior_floors, air_walls, apertures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; plug-in component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
deconstructmodel = HBDeconstructModel(model=loadobjects.hb_objs)  # -> rooms, faces, apertures, doors, shades; plug-in component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
panel_3 = Panel("C:\Users\devan\Desktop\generate_data.py")
deconstructmodel_2 = HBDeconstructModel(model=loadobjects.hb_objs)  # -> rooms, faces, apertures, doors, shades; plug-in component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
vizquick = HBVizualizeQuick(hb_objs=flatten(deconstructmodel.apertures))  # -> geo; plug-in component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
vec = VectorXYZ(XComponent=0, YComponent=0, ZComponent=0)  # -> Vector, Length
vec_2 = VectorXYZ(XComponent=0, YComponent=0, ZComponent=0)  # -> Vector, Length
vizquick_2 = HBVizualizeQuick(hb_objs=flatten(deconstructmodel_2.rooms))  # -> geo; plug-in component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
vizquick_3 = HBVizualizeQuick(hb_objs=flatten(deconstructmodel_2.apertures))  # -> geo; plug-in component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
facen = FaceNormals(Mesh=vizquick)  # -> Centers, flatten(Normals)
vizquick_4 = HBVizualizeQuick(hb_objs=flatten(deconstructmodel_2.doors))  # -> geo; plug-in component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
vizquick_5 = HBVizualizeQuick(hb_objs=flatten(deconstructmodel_2.shades))  # -> geo; plug-in component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
area = Area(Geometry=vizquick)  # -> Area, Centroid
file = ReadFile(File="D:\Github\honeybee-ifc\scripts\generate_data.py", PerLineParse=False)
xprod = CrossProduct(Unitize=False)  # -> Vector, Length
wires = BrepWireframe(Brep=[vizquick_2, vizquick_5], Density=-1)
python = GhPythonScript(Code=file, X=area.Centroid, Y=facen.Normals)  # -> Out, A
panel_4 = Panel(area.Centroid)
preview = CustomPreview(Geometry=vizquick_3, Material=ColourSwatch(SwatchColor=RGB(0, 210, 255)))
preview_2 = CustomPreview(Geometry=vizquick_4, Material=ColourSwatch(SwatchColor=RGB(58, 0, 0)))
facen_2 = FaceNormals(Mesh=vizquick_3)  # -> Centers, Normals
facen_3 = FaceNormals(Mesh=vizquick_4)  # -> Centers, Normals
vdis = VectorDisplay(Anchor=facen_2.Centers, Vector=facen_2.Normals)
vdis_2 = VectorDisplay(Anchor=facen_3.Centers, Vector=facen_3.Normals)
pt = Point()
list = ItemSelector({"0.80, 6.47, 2.87", "0.80, 6.47, 2.87", "2.00, 6.47, 2.87", "3.20, 6.47, 2.87", "0.80, 6.47, 2.87"}, selected="0.80, 6.47, 2.87")
pt_2 = Point(list)
